# Grasshopper definition bedtable.gh (Grasshopper 1.0.7)
# plug-ins: Pufferfish

vertical_thickness = Slider(3.18, range=0..25.4)
table_thickness = Slider(3.18, range=0..25.4)
notch_length = Slider(53.5, range=10..150)
tolerances = Slider(0.13, range=0..1)
fillet_radius = Slider(20, range=0..20)
width = Slider(100, range=50..200)
height = Slider(100, range=50..200)
length = Slider(150, range=50..350)
panel = Panel("horizontal (table) components")
rectangle = Rectangle(Plane=PlaneXY(0, 0, 0), XSize=width, YSize=height, Radius=0)  # -> Rectangle, Length
xz = XZPlane(Origin=Point(0, 0, 0))
rectangle_2 = Rectangle(Plane=xz, XSize=width, YSize=length, Radius=0)  # -> Rectangle, Length
boxrec = BoxRectangle(Rectangle=rectangle.Rectangle, Height=vertical_thickness)
panel_2 = Panel("vertical (wall side) components")
subtraction = Subtraction(A=width, B=notch_length)
Z = UnitZ(Factor=vertical_thickness)
boxrec_2 = BoxRectangle(Rectangle=rectangle_2.Rectangle, Height=table_thickness)
cluster = X2(A=subtraction)
subtraction_2 = Subtraction(A=cluster, B=tolerances)
box_corners = BoxCorners(Box=boxrec)  # -> CornerA, CornerB, CornerC, CornerD, CornerE, CornerF, CornerG, CornerH
move = Move(Geometry=boxrec_2, Motion=Z)  # -> Geometry, Transform
X = UnitX(Factor=subtraction_2)
neg = Negative(Value=subtraction_2)
twn2pts = TweenTwoPoints(PointA=box_corners.CornerE, PointB=box_corners.CornerF, Factor=0.5)
twn2pts_2 = TweenTwoPoints(PointA=box_corners.CornerA, PointB=box_corners.CornerB, Factor=0.5)
cluster_2 = X2(A=notch_length)
cluster_3 = X2(A=vertical_thickness)
X_2 = UnitX(Factor=neg)
twn2pts_3 = TweenTwoPoints(PointA=twn2pts_2, PointB=twn2pts, Factor=0.5)
box_corners_2 = BoxCorners(Box=move.Geometry)  # -> CornerA, CornerB, CornerC, CornerD, CornerE, CornerF, CornerG, CornerH
xz_2 = XZPlane(Origin=twn2pts_3)
box = CenterBox(Base=xz_2, X=cluster_2, Y=cluster_3, Z=table_thickness)
move_2 = Move(Geometry=box_corners_2.CornerA, Motion=X)  # -> Geometry, Transform
brep = Brep([boxrec, box])
move_3 = Move(Geometry=box_corners_2.CornerF, Motion=X_2)  # -> Geometry, Transform
sunion = SolidUnion(Breps=brep)
rec_3pt = Rectangle3Pt(PointA=box_corners_2.CornerB, PointB=box_corners_2.CornerF, PointC=move_3.Geometry)  # -> Rectangle, Length
rec_3pt_2 = Rectangle3Pt(PointA=box_corners_2.CornerA, PointB=move_2.Geometry, PointC=box_corners_2.CornerE)  # -> Rectangle, Length
index_2 = Slider(14, range=0..33)
number_slider = Slider(15, range=0..33)
# index hack to find correct edges to fillet
edges = BrepEdges(Brep=sunion)  # -> Naked, Interior, NonManifold
boxrec_3 = BoxRectangle(Rectangle=rec_3pt_2.Rectangle, Height=vertical_thickness)
boxrec_4 = BoxRectangle(Rectangle=rec_3pt.Rectangle, Height=vertical_thickness)
item = ListItem(List=edges.Interior, Index=[number_slider, index_2], Wrap=True)
brep_2 = Brep([move.Geometry, boxrec_3, boxrec_4])
sunion_2 = SolidUnion(Breps=brep_2)
filedge = FilletEdge(Shape=sunion, Blend=0, Metric=0, Edges=[number_slider, index_2], Radii=fillet_radius)
index_2_2 = Slider(30, range=0..33)
number_slider_2 = Slider(31, range=0..33)
# index hack to find correct edges to fillet
edges_2 = BrepEdges(Brep=sunion_2)  # -> Naked, Interior, NonManifold
item_2 = ListItem(List=edges_2.Interior, Index=[number_slider_2, index_2_2], Wrap=True)
filedge_2 = FilletEdge(Shape=sunion_2, Blend=0, Metric=0, Edges=[number_slider_2, index_2_2], Radii=fillet_radius)
preview = CustomPreview(
    Geometry=[filedge_2, filedge],
    Material={diffuse=RGB(228, 178, 227), emission=RGB(68, 53, 68), shine=0.5, specular=RGB(255, 254, 255), transparency=0})

# ==== cluster X2
A = ClusterInput()
division = Division(A=A, B="2")
R = ClusterOutput(division)
